# Grasshopper definition TTC_Workflow_V2.gh (Grasshopper 1.0.8)
# plug-ins: Karamba3D

# ----
# CroSec Catalogue
# INPUT for LLM:
# 
# "You can choose from this list of Crosssections"
crosecrselect = CrossSectionRangeSelectorKaramba3D(MaximumHeight_cm=-1, MaximumWidth_cm=-1, menu=[dropdown(1), dropdown(1), dropdown(2), dropdown(0)])

list = ValueList({"NEW TRUSS": 0, "ITERATION": 1}, selected="NEW TRUSS")

# ----
# Agent Communication
chat_input_user_prompt = Panel("""I need steel Bowstring truss, spanning 15 meters. The roof itself is 30 x 15 metres and has a weight of 10 kN/m². 

Can you create the truss needed to withstand this force.""")
ttc_post_run_pipeline = Python3Script(prompt=chat_input_user_prompt, arm=Toggle(True), run=Button(), mode=list, CroSec=crosecrselect)  # -> run_id; inputs prompt: String, arm: Boolean, run: Boolean, CroSec: list
# ---------- ttc_post_run_pipeline: Python ----------
# GH component: TTC Run Pipeline
# Copy-paste into a GHPython component. Runs only when Run is clicked (armed + button + prompt).
# Output run_id connects to the next component in the chain (e.g. TTC Fetch Interpreter Returns).
#
# GHPython (CPython 3, Rhino 8):
#   Input  prompt: str — user prompt (e.g. "gable truss 12 m span, steel")
#   Input  CroSec: str or list — cross-section catalogue. Either a single string with lines like
#           family:'HEA' name:'HEA100' country:'EU' material:'Steel' applies to elements:''; 
#           or a list of profile name strings (e.g. ["HEA100","HEA120",...]). Used by Generator to assign one profile per member.
#   Input  run:    wire Button — click to run pipeline (only when armed). Runs once per pulse (rising edge).
#   Input  arm:    bool — True = armed, False = disarmed
#   Output run_id: str — pass to next component in chain

import os
import re
import sys
from pathlib import Path

# State file for rising-edge detection: run pipeline only when run goes False → True (one API run per click).
_TTC_RUN_STATE_FILE = None  # set after REPO_ROOT is defined


def _run_trigger_rising_edge(run_val):
    """Return True only when run_val is True this time and was False last time (single run per button click)."""
    global _TTC_RUN_STATE_FILE
    if _TTC_RUN_STATE_FILE is None:
        return bool(run_val)  # fallback if state file not set
    try:
        prev = _TTC_RUN_STATE_FILE.read_text().strip().lower() == "true"
    except Exception:
        prev = False
    is_run = bool(run_val)
    try:
        _TTC_RUN_STATE_FILE.write_text("True" if is_run else "False", encoding="utf-8")
    except Exception:
        pass
    return is_run and not prev


def _parse_crosec_catalog(crosec_input):
    """Parse CroSec input to a list of profile name strings. Handles GH catalogue string format or list of names."""
    if crosec_input is None:
        return []
    if hasattr(crosec_input, "__iter__") and not isinstance(crosec_input, str):
        # List of items from GH (e.g. list of strings)
        try:
            items = list(crosec_input)
            if not items:
                return []
            # If first item looks like "family:'HEA' name:'HEA100' ...", parse each
            first = str(items[0])
            if "name:'" in first or 'name:"' in first:
                names = []
                for item in items:
                    s = str(item).strip()
                    m = re.search(r"name:\s*['\"]([^'\"]+)['\"]", s)
                    if m:
                        names.append(m.group(1))
                return names
            # Otherwise treat as list of profile names
            return [str(x).strip() for x in items if str(x).strip()]
        except (TypeError, IndexError):
            return []
    s = str(crosec_input).strip()
    if not s:
        return []
    names = []
    for line in s.replace(";", "\n").splitlines():
        line = line.strip()
        if not line:
            continue
        m = re.search(r"name:\s*['\"]([^'\"]+)['\"]", line)
        if m:
            names.append(m.group(1))
    return names

REPO_ROOT = r"C:\Users\levin\Documents\GitHub\gh-text-to-code-ai-integration"
if not os.path.isdir(os.path.join(REPO_ROOT, "03_python")):
    _cwd = Path(os.getcwd()).resolve()
    if (_cwd / "03_python").is_dir():
        REPO_ROOT = str(_cwd)
    elif _cwd.name == "02_grasshopper" and (_cwd.parent / "03_python").is_dir():
        REPO_ROOT = str(_cwd.parent)

# Rising-edge state file (run only once per button click)
_TTC_RUN_STATE_FILE = Path(REPO_ROOT) / ".ttc_gh_run_prev"

SCRIPTS_DIR = os.path.join(REPO_ROOT, "03_python")
if SCRIPTS_DIR not in sys.path:
    sys.path.insert(0, SCRIPTS_DIR)
os.environ["TTC_03_PYTHON"] = os.path.abspath(SCRIPTS_DIR)

_env_path = os.path.join(REPO_ROOT, "00_setup", ".env")
if os.path.isfile(_env_path):
    try:
        from dotenv import load_dotenv
        load_dotenv(_env_path)
    except ImportError:
        pass
    if not (os.environ.get("ANTHROPIC_API_KEY") or os.environ.get("CLAUDE_API_KEY")):
        with open(_env_path) as _f:
            for _line in _f:
                _line = _line.strip()
                if _line and not _line.startswith("#") and "=" in _line:
                    _k, _, _v = _line.partition("=")
                    _k, _v = _k.strip(), _v.strip()
                    if _v.startswith('"') and _v.endswith('"'): _v = _v[1:-1]
                    elif _v.startswith("'") and _v.endswith("'"): _v = _v[1:-1]
                    if _k:
                        os.environ.setdefault(_k, _v)

from ttc_main import run as run_pipeline, get_latest_run_id

armed = bool(arm) if arm is not None else False
run_val = bool(run) if run is not None else False
run_triggered = _run_trigger_rising_edge(run_val)  # True only on rising edge (one run per click)
prompt_text = str(prompt).strip() if prompt else ""
try:
    crosec_catalog = _parse_crosec_catalog(CroSec) if CroSec is not None else []
except NameError:
    crosec_catalog = []  # CroSec input not yet added to component

do_run = armed and run_triggered and bool(prompt_text)

if do_run:
    try:
        out = run_pipeline(prompt_text, run_id=None, cross_section_catalog=crosec_catalog)
        run_id = out.get("run_id", "")
    except Exception as e:
        run_id = ""
else:
    # When not running, pass through latest run_id so the chain still has a value
    run_id = get_latest_run_id() or ""
# ---------- end ttc_post_run_pipeline ----------
ttc_get_interpreter = Python3Script(run_id=ttc_post_run_pipeline)  # -> run_id, run_commentary, communication; inputs run_id: String
# ---------- ttc_get_interpreter: Python ----------
# GH component: TTC Fetch Interpreter Returns
# Input run_id → output run_id (pass-through). Reads communication.txt and run_commentary.txt from run_output.
# Outputs one string each (newlines collapsed to space) so Panel shows a single item.
#
# Input  run_id: str
# Output run_id: str (same as input)
# Output communication: str
# Output run_commentary: str

REPO_ROOT = r"C:\Users\levin\Documents\GitHub\gh-text-to-code-ai-integration"
RUN_OUTPUT_DIR = REPO_ROOT + r"\03_python\run_output"

run_id = str(run_id).strip() if run_id else ""

communication = ""
run_commentary = ""
if run_id:
    base = RUN_OUTPUT_DIR + "\\" + run_id
    try:
        with open(base + "\\communication.txt", encoding="utf-8") as f:
            communication = f.read()
        # Collapse newlines to space so GH Panel shows one string, not a list of lines
        communication = " ".join(communication.split())
    except Exception:
        pass
    try:
        with open(base + "\\run_commentary.txt", encoding="utf-8") as f:
            run_commentary = f.read()
        run_commentary = " ".join(run_commentary.split())
    except Exception:
        pass
# ---------- end ttc_get_interpreter ----------
chat_output = Panel(ttc_get_interpreter.communication)
panel = Panel(ttc_get_interpreter.run_commentary)
run_id = Panel(ttc_get_interpreter.run_id)

ttc_get_executor = Python3Script(run_id=run_id)  # -> status, Line_Elements, CroSec, Support, Loads, Load_Points; inputs run_id: String
# ---------- ttc_get_executor: Python ----------
# GH component: TTC Fetch Executor (geometric_output.json).
# Input run_id → output run_id (pass-through). Reads geometric_output.json from run_output, parses to GH geometry.
# Structure follows config/geometric_outline.json: line_elements (start, end, cross_section), support, loads.
#
# Input  run_id: str (or list with one str from GH wire)
# Output run_id: str (same as input)
# Output status: str
# Output Line_Elements, Support, Loads, Load_Points, CroSec
#   CroSec: list of cross_section name strings, one per line element (same order as Line_Elements)

import json
import os

REPO_ROOT = r"C:\Users\levin\Documents\GitHub\gh-text-to-code-ai-integration"
RUN_OUTPUT_DIR = os.path.join(REPO_ROOT, "03_python", "run_output")

try:
    import Rhino.Geometry as rg
except ImportError:
    rg = None

# GH may pass a list; take first element so path is a plain string
if run_id is not None and hasattr(run_id, "__getitem__") and not isinstance(run_id, str):
    try:
        run_id = run_id[0]
    except (IndexError, TypeError, KeyError):
        run_id = ""
run_id = str(run_id).strip() if run_id else ""

if not run_id:
    status = "No run_id provided."
    Line_Elements = []
    Support = []
    Loads = []
    Load_Points = []
    CroSec = []
else:
    path = os.path.join(RUN_OUTPUT_DIR, run_id, "geometric_output.json")
    status = "OK"
    Line_Elements = []
    Support = []
    Loads = []
    Load_Points = []
    CroSec = []
    try:
        with open(path, encoding="utf-8") as f:
            geo = json.load(f)
        line_elems = geo.get("line_elements") or []
        if rg:
            for seg in line_elems:
                s, e = seg.get("start"), seg.get("end")
                if s and e and len(s) >= 2 and len(e) >= 2:
                    Line_Elements.append(rg.Line(rg.Point3d(s[0], 0.0, s[1]), rg.Point3d(e[0], 0.0, e[1])))
                CroSec.append(str(seg.get("cross_section") or ""))
            for xz in geo.get("support") or []:
                if xz and len(xz) >= 2:
                    Support.append(rg.Point3d(xz[0], 0.0, xz[1]))
            for ld in geo.get("loads") or []:
                if ld and len(ld) >= 3:
                    Load_Points.append(rg.Point3d(ld[0], 0.0, ld[1]))
                    Loads.append(rg.Vector3d(0.0, 0.0, ld[2]))
        else:
            for seg in line_elems:
                CroSec.append(str(seg.get("cross_section") or ""))
    except Exception as err:
        status = str(err)
# ---------- end ttc_get_executor ----------
panel_2 = Panel(ttc_get_executor.status)
panel_3 = Panel(ttc_get_executor.Loads)

# ----
# Karamba Analysis Workflow
line_elements = Data(ttc_get_executor.Line_Elements)
crosec = Data(ttc_get_executor.CroSec)
support_points = Data(ttc_get_executor.Support)
loads = Data(ttc_get_executor.Loads)
load_points = Data(ttc_get_executor.Load_Points)

crosecselect = CrossSectionSelectorKaramba3D(NameOrListIndexOfCrossSection=crosec)  # -> CrossSection, Info
supp = SupportKaramba3D(PosInd=support_points, Ct_kN_m=Vector(0, 0, 0), Cr_kNm_rad=Vector(0, 0, 0), menu=[buttons(on, on, on, on, on, on)])  # -> flatten(Support)
loads_2 = LoadsKaramba3D(Vector=Vector(0, 0, -1), LCase="LC0", mode="Gravity")
loads_3 = LoadsKaramba3D(ForceVector=loads, Local=False, PosInd=load_points, LCase="LC0", mode="Point")
lineelem = CreateLinearElementKaramba3D(
    Line=line_elements,
    CrossSection=crosecselect.CrossSection,
    LimitDistance_m=0.005,
    BucklingLengthY_m=-1,
    BucklingLengthZ_m=-1,
    BucklingLengthLT_m=-1,
    Bending=True,
    ToPolylineMaxAngle=0.25,
    ToPolylineTolerance=0.1,
    ToPolylineMaxEdgeLength=0.25,
    New=True,
    Remove=True,
    mode="LineToBeam",
    GuidGeneratorSeed=-236662677)  # -> flatten(Element), Points, Info
merge = Merge(Data1=loads_3, Data2=loads_2)  # -> flatten(Result)

assemble = AssembleModelKaramba3D(Elem=lineelem.Element, Support=supp, Load=merge, LimitDistance_m=0.005)  # -> Model, Info, Mass_kg, CentreOfGravity, LoadCaseNames
analyse = AnalyseKaramba3D(Model=assemble.Model)  # -> AnalysedModel, MaximumDisplacement_cm, ResultingForce_kN, ChangeOfElasticEnergy_kNm
modelview = ModelViewKaramba3D(Model=analyse.AnalysedModel)  # -> Model, DeformedMesh, DeformedAxes, DeformedModel, MaximumDeformation
beamview = BeamViewKaramba3D(Model=modelview.Model)  # -> Model, MeshesOfRenderedBeams, DeformedBeamAxes, LegendColours, LegendTags
legend = LegendKaramba3D(
    Colors=beamview.LegendColours,
    Tags=beamview.LegendTags,
    Scale=0.8,
    Textsize=30,
    Legend_HasHeader=False,
    Legend_Justification=2,
    Legend_Position=2)

# ----
# Test Geometry
_01_test_geometry = _01_Test_Geometry()
load_point_selection = Load_Point_Selection(C=_01_test_geometry)
support_selection = Support_Selection(C=_01_test_geometry)
data = Data(_01_test_geometry)
data_2 = Data(support_selection)
data_3 = Data(load_point_selection)

lng = ListLength(List=load_point_selection)
neg = Negative(Value=Slider(50, range=0..100))
dup = DuplicateData(Data=neg, Number=lng, Order=True)
Z = UnitZ(Factor=dup)

loads_4 = Data(Z)

# ==== cluster _01_Test_Geometry
pipeline = GeometryPipeline(
    GroupByLayer=False,
    GroupByType=False,
    IncludeHidden=True,
    IncludeLocked=True,
    LayerFilter="01__Text Geometry",
    NameFilter="*",
    SublayerFiltering=True,
    TypeFilter=4)
split = SplitList(List=pipeline, Index="1")  # -> ListA, ListB
clx = CurveLine(Curve=split.ListA, Line=split.ListB)  # -> flatten(Points), flatten(Params), Count
cullpt = CullDuplicates(Points=clx.Points, Tolerance=0.1, CullMode=1)  # -> Points, Indices, Valence
item = ListItem(List=clx.Params, Index=cullpt.Indices, Wrap=True)
shatter = Shatter(Curve=split.ListA, Parameters=item)  # -> flatten(Segments)
explode = Explode(Curve=shatter, Recursive=True)  # -> flatten(Segments), Vertices
data = Data(split.ListB)
merge = Merge(Data1=explode.Segments, Data2=data)  # -> flatten(Line_Elements)
line_elements = ClusterOutput(merge)

# ==== cluster Load_Point_Selection
C = ClusterInput()
end = EndPoints(Curve=C)  # -> Start, End
merge = Merge(Data1=end.Start, Data2=end.End)  # -> flatten(Result)
rdpoints = RemoveDuplicatePointsKaramba3D(Point=merge, LimitDistance=0.005)  # -> OutPoint, Info, Indexes
pdecon = Deconstruct(Point=rdpoints.OutPoint)  # -> XComponent, YComponent, ZComponent
larger = LargerThan(FirstNumber=pdecon.ZComponent, SecondNumber=Slider(3.37, range=0..10))  # -> LargerThan, OrEqualTo
cull = CullPattern(List=rdpoints.OutPoint, CullPattern=larger.LargerThan)
loads_top_chord = ClusterOutput(cull)

# ==== cluster Support_Selection
C = ClusterInput()
end = EndPoints(Curve=C)  # -> Start, End
merge = Merge(Data1=end.Start, Data2=end.End)  # -> flatten(Result)
rdpoints = RemoveDuplicatePointsKaramba3D(Point=merge, LimitDistance=0.005)  # -> OutPoint, Info, Indexes
pdecon = Deconstruct(Point=rdpoints.OutPoint)  # -> XComponent, YComponent, ZComponent
larger = LargerThan(FirstNumber=pdecon.ZComponent, SecondNumber=Slider(3.37, range=0..10))  # -> LargerThan, OrEqualTo
cull = CullPattern(List=rdpoints.OutPoint, CullPattern=invert(larger.LargerThan))
pdecon_2 = Deconstruct(Point=cull)  # -> XComponent, YComponent, ZComponent
sort = SortList(Keys=pdecon_2.XComponent, ValuesA=cull)  # -> Keys, ValuesA
panel = Panel("""0
-1""")
item = ListItem(List=sort.ValuesA, Index=panel, Wrap=True)  # -> flatten(Item)
i = ClusterOutput(item)
